# Grasshopper definition EN17037 schedule.gh (Grasshopper 1.0.7)
# Copyright: 2021
# Sets the schedule to brightest half of the year.

# ----
# COPYRIGHT LINK ARKITEKTUR 2021:
# 
# This script is not to be shared with anyone outside project scope.
# Description: Sets the schedule to brightest half of the year.
# Project: For LBT tools 1.3
pr = Panel("00000")
plugin_dependencies = Panel(""" 
Ladybug Tools """)
username = Panel("Mathias Sønderskov Schaltz")
toolversion = Panel("1.0.0")
grasshopper_file = Panel("unnamed")
# For LBT tools 1.3
# EN17037 Schedule
# Template Headers
toolname = Panel("EN17037 Schedule")

# ---- group: gi_
# Colors
# Inputs
geometry = Data(0)

# ---- group: pi_
param = Data(0)

# ---- group: oi_
other = Data(0)

# ---- group: r_
rev = Data(0)

# ---- group: g_
# Group
general = Data(0)

# ---- group: c_
core = Data(0)

# ---- group: o_
# Out
output = Data(0)

# ---- group: v_
# Revision
visual = Data(0)

# ----
open_map = Button()
import_new_url = Panel("https://energyplus-weather.s3.amazonaws.com/europe_wmo_region_6/NOR/NOR_Oslo.Fornebu.014880_IWEC/NOR_Oslo.Fornebu.014880_IWEC.zip")
epwmap = LBEPWmap(epw_map=open_map)  # -> report; plug-in component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
downloadepw = LBDownloadWeather(weather_URL=import_new_url)  # -> epw_file, stat_file, ddy_file; plug-in component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
# preview me in rhino
# if the component has any errors, try rerunning it >_<
en17037 = GhPythonScript(epw_file=downloadepw.epw_file, brightest_x_hours="4380")  # -> wea, schedule, data, mesh; inputs brightest_x_hours: Int32
# ---------- en17037: Python ----------
__author__ = "Mathias Sønderskov Schaltz"
__version__ = "2021.10.13"

import rhinoscriptsyntax as rs

import ladybug


ghenv.Component.Description = "EN17037 Schedules set for the brightest hours of the year.\nCreated for lbt 1.3.0\n2021 Mathias Sønderskov"
ghenv.Component.NickName = "EN17037"
ghenv.Component.Message = "1.3.0*"

ghenv.Component.Params.Input[0].Description = "Epw file"
ghenv.Component.Params.Input[1].Description = "Number of brightest hours to schedule. Default should be 4380 (for brightest 50% of year)"

ghenv.Component.Params.Output[0].Description = "Wea file"
ghenv.Component.Params.Output[1].Description = "Schedule"
ghenv.Component.Params.Output[2].Description = "data put into LB Hourly Plot"
ghenv.Component.Params.Output[3].Description = "Mesh to preview the hours"


try:  # import the ladybug dependencies
    from ladybug.dt import Date
except ImportError as e:
    raise ImportError('\nFailed to import ladybug:\n\t{}'.format(e))

try:  # import the core honeybee dependencies
    from honeybee.typing import clean_and_id_ep_string, clean_ep_string
except ImportError as e:
    raise ImportError('\nFailed to import honeybee:\n\t{}'.format(e))

try:  # import the honeybee-energy dependencies
    from honeybee_energy.schedule.fixedinterval import ScheduleFixedInterval
    from honeybee_energy.lib.scheduletypelimits import schedule_type_limit_by_identifier
except ImportError as e:
    raise ImportError('\nFailed to import honeybee_energy:\n\t{}'.format(e))

try:  # import ladybug_rhino dependencies
    from ladybug_rhino.grasshopper import all_required_inputs
except ImportError as e:
    raise ImportError('\nFailed to import ladybug_rhino:\n\t{}'.format(e))
    
    
try:  # import the honeybee-energy dependencies
    from honeybee_energy.schedule.ruleset import ScheduleRuleset
    from honeybee_energy.lib.schedules import schedule_by_identifier
except ImportError as e:
    raise ImportError('\nFailed to import honeybee_energy:\n\t{}'.format(e))







week_start_day = 'Monday'
start_date, end_date, timestep = Date(1, 1), Date(12, 31), 1
holidays = None

# create the DataCollection




wea = ladybug.wea.Wea.from_epw_file(epw_file)

irradiance_values = wea.global_horizontal_irradiance.values

hoys_brightest_half = [hoy for irradiance, hoy  in sorted(zip(irradiance_values,range(8760)))]
hoys_brightest_half.reverse()


schedule_values = [0] * 8760

for hoy in hoys_brightest_half[0:brightest_x_hours - 1]:
    schedule_values[hoy] = 1


# create the schedule object
schedule = ScheduleFixedInterval(
    "Daylight EN17037", schedule_values, schedule_type_limit_by_identifier('Fractional'), 1, Date(1, 1),
    placeholder_value=0, interpolate=False)

schedule.display_name = "Daylight EN17037"


if isinstance(schedule, ScheduleRuleset):
    data = schedule.data_collection(
        timestep, start_date, end_date, week_start_day, holidays, leap_year=False)
else:  # assume that it is a ScheduleFixedInterval
    data = schedule.data_collection_at_timestep(timestep, start_date, end_date)



try:
    from ladybug.datacollection import HourlyContinuousCollection
    from ladybug.hourlyplot import HourlyPlot
except ImportError as e:
    raise ImportError('\nFailed to import ladybug:\n\t{}'.format(e))

try:
    from ladybug_geometry.geometry3d.pointvector import Point3D
    from ladybug_geometry.geometry3d.plane import Plane
except ImportError as e:
    raise ImportError('\nFailed to import ladybug_geometry:\n\t{}'.format(e))

try:
    from ladybug_rhino.config import conversion_to_meters
    from ladybug_rhino.togeometry import to_point3d
    from ladybug_rhino.fromgeometry import from_mesh3d, from_mesh2d, \
        from_polyline2d, from_linesegment2d
    from ladybug_rhino.text import text_objects
    from ladybug_rhino.fromobjects import legend_objects
    from ladybug_rhino.grasshopper import all_required_inputs, list_to_data_tree
except ImportError as e:
    raise ImportError('\nFailed to import ladybug_rhino:\n\t{}'.format(e))



# apply any analysis periods and conditional statements to the input collections

_base_pt_ = None
_x_dim_ = None
_y_dim_ = None
_z_dim_ = None
reverse_y_ = None
legend_par_ = []

# set default values for the chart dimensions
_base_pt_ = to_point3d(_base_pt_) if _base_pt_ is not None else Point3D()

_x_dim_ = _x_dim_ if _x_dim_ is not None else 1.0 / conversion_to_meters()
_y_dim_ = _y_dim_ if _y_dim_ is not None else 4.0 / conversion_to_meters()
_z_dim_ = _z_dim_ if _z_dim_ is not None else 0
reverse_y_ = reverse_y_ if reverse_y_ is not None else False

# empty lists of objects to be filled with visuals
mesh, title, all_legends, all_borders, all_labels = [], [], [], [], []

data_coll = data
i = 0

#for i, data_coll in enumerate(data):
try:  # sense when several legend parameters are connected
    lpar = legend_par_[i]
except IndexError:
    lpar = None if len(legend_par_) == 0 else legend_par_[-1]

# create the hourly plot object and get the main pieces of geometry
hour_plot = HourlyPlot(data_coll, lpar, _base_pt_,
                       _x_dim_, _y_dim_, _z_dim_, reverse_y_)
msh = from_mesh2d(hour_plot.colored_mesh2d, _base_pt_.z) if _z_dim_ == 0 else \
    from_mesh3d(hour_plot.colored_mesh3d)
mesh.append(msh)
border = [from_polyline2d(hour_plot.chart_border2d, _base_pt_.z)] + \
    [from_linesegment2d(line, _base_pt_.z) for line in hour_plot.hour_lines2d] + \
    [from_linesegment2d(line, _base_pt_.z) for line in hour_plot.month_lines2d]
all_borders.append(border)
legnd = legend_objects(hour_plot.legend)
all_legends.append(legnd)
tit_txt = text_objects(hour_plot.title_text, hour_plot.lower_title_location,
                       hour_plot.legend_parameters.text_height,
                       hour_plot.legend_parameters.font)
title.append(tit_txt)

# create the text label objects
label1 = [text_objects(txt, Plane(o=Point3D(pt.x, pt.y, _base_pt_.z)),
                       hour_plot.legend_parameters.text_height,
                       hour_plot.legend_parameters.font, 2, 3)
          for txt, pt in zip(hour_plot.hour_labels, hour_plot.hour_label_points2d)]
label2 = [text_objects(txt, Plane(o=Point3D(pt.x, pt.y, _base_pt_.z)),
                       hour_plot.legend_parameters.text_height,
                       hour_plot.legend_parameters.font, 1, 0)
          for txt, pt in zip(hour_plot.month_labels, hour_plot.month_label_points2d)]
all_labels.append(label1 + label2)

# increment the base point so that the next chart doesn't overlap this one
try:
    next_tstep = data.header.analysis_period.timestep
except IndexError:
    next_tstep = 1
increment = 24 * next_tstep * _y_dim_ * 1.5
_base_pt_ = Point3D(_base_pt_.x, _base_pt_.y - increment, _base_pt_.z)

# convert nexted lists into data trees
legend = list_to_data_tree(all_legends)
borders = list_to_data_tree(all_borders)
labels = list_to_data_tree(all_labels)
# ---------- end en17037 ----------
