# Grasshopper definition HumanUI_SaveState.gh (Grasshopper 1.0.8)
# Copyright: 2021
# plug-ins: Human UI

# ----
# COPYRIGHT LINK ARKITEKTUR 2023:
# 
# This script is not to be shared with anyone outside project scope.
# Plugin Dependencies: LINK_EP 2.5.20163.38249
# Human UI 0.8.8
# Template Full
pr = Panel("00000")
toolversion = Panel("1.0.0")
grasshopper_file = Panel("GH_TEMPLATE")
# ProjectName
# Update Human
# Template Headers
toolname = Panel("Update Human")
project = Panel("ProjectName")

# ---- group: gi_
# Colors
# Inputs
geometry = Data(0)

# ---- group: pi_
param = Data(0)

# ---- group: oi_
other = Data(0)

# ---- group: 1_
data = Data(0)

# ---- group: 2_
data_2 = Data(0)

# ---- group: 3_
data_3 = Data(0)

# ---- group: r_
# Custom
rev = Data(0)

# ---- group: g_
# Group
general = Data(0)

# ---- group: c_
core = Data(0)

# ---- group: o_
# Out
output = Data(0)

# ---- group: v_
# Revision
visual = Data(0)

# ----
# load the actual list (at LINK we do this in async)
value = Panel("""Copenhagen.epw
Oslo.epw""")
display_value = Panel("""<Select One>
Copenhagen
Oslo""")

# ----
# create a dropdown with a default value
panel = Panel("Loading")
create_pulldown_menu = CreatePulldownMenu(Label="EPW file", ListItems=panel, showLabel=True)

# ----
# show the window
toggle = BooleanToggle(True)
launchwin = LaunchWindow(Show=toggle, Name="Control Window", Width=370, Height=400, ChildStatus=0, EnableHorizScroll=False)
addelems = AddElements(Window=launchwin, Elements=flatten(create_pulldown_menu), DoVLChecking=True)  # -> AddedElements, ElementNames

# ----
# set the dropdown to the index in notes
read_epw_notes = GhPythonScript(epw_paths=value, epw_files=display_value)  # -> notes, index; inputs epw_paths: list, epw_files: list
# ---------- read_epw_notes: Python ----------
__author__ = "mm1013"
__version__ = "2023.04.19"

import rhinoscriptsyntax as rs
import Rhino


if Rhino.RhinoDoc.ActiveDoc.Notes is not None and len(Rhino.RhinoDoc.ActiveDoc.Notes) > 0:
    for line in Rhino.RhinoDoc.ActiveDoc.Notes.split("\n"):
        if line[0:3] == "EPW":
            epw_file = line[4:]
            break
    
    for i, path in enumerate(epw_paths):
        if path is None:
            continue
        if epw_file in path:
            index = i
            break
else:
    index = 0
# ---------- end read_epw_notes ----------
setlist = SetListContents(ListToModify=create_pulldown_menu, NewListContents=display_value, SelectedIndex=read_epw_notes.index)

value_listener = ValueListener(Elements=create_pulldown_menu, SomeProperty=True)  # -> Values, Indices

# ----
# read the actual values
item = ListItem(List=value, Index=value_listener.Indices, Wrap=True)
the_picked_one = Panel(item)
the_picked_one_2 = Panel(value_listener.Values)

# ----
# write to rhino file every time we change dropdown
save_epw_notes = GhPythonScript(index=value_listener.Indices, epw_files=display_value)  # inputs index: Int32, epw_files: list
# ---------- save_epw_notes: Python ----------
__author__ = "mm1013"
__version__ = "2023.04.19"

import rhinoscriptsyntax as rs
import Rhino
if epw_files is not None and len(epw_files) > 1:
    was_set = False
    if Rhino.RhinoDoc.ActiveDoc.Notes is not None and len(Rhino.RhinoDoc.ActiveDoc.Notes) > 0:
        lines = Rhino.RhinoDoc.ActiveDoc.Notes.replace("\r","\n").split("\n")
        for i,line in enumerate(lines):
            if line[0:3] == "EPW":
                lines[i] = "EPW=" + epw_files[index]
                was_set = True
                break
                
                
        Rhino.RhinoDoc.ActiveDoc.Notes = "\n".join(lines)
        if was_set == False:
            Rhino.RhinoDoc.ActiveDoc.Notes += "\nEPW=" + epw_files[index]
    else:
        Rhino.RhinoDoc.ActiveDoc.Notes = "EPW=" + epw_files[index]
        
        
    for line in Rhino.RhinoDoc.ActiveDoc.Notes.split("\n"):
        print line
# ---------- end save_epw_notes ----------
