# Grasshopper definition share_LBT_Sunhours.gh (Grasshopper 1.0.8)
# Copyright: 2021
# plug-ins: Human, ImageClipboard

# ----
# COPYRIGHT LINK ARKITEKTUR 2026:
# 
# This script is not to be shared with anyone outside project scope.
# Plugin Dependencies: Human 1.3.1
# ImageClipboard
# Ladybug Tools 1.7.1
# Template Full
pr = Panel("00000")
created = Panel("2026-02-19")
grasshopper_folder = Panel("Q:\LINK IO\Share\20260123_MSS")
username = Panel("Mathia Sønderskov Schaltz")
toolversion = Panel("1.0.0")
grasshopper_file = Panel("share_LBT_Sunhours")
# Share
# Daily Solar Access
# Template Headers
toolname = Panel("Daily Solar Access")
project = Panel("Share")

# ---- group: gi_
# Colors
# Inputs
geometry = Data(0)

# ---- group: pi_
# Requires Ladybug tools.
# 
# Get it free with Pollination Cloud
# 
# 
# https://www.pollination.solutions/rhino-plugin#grasshopper
param = Data(0)

# ---- group: oi_
other = Data(0)

# ---- group: 1_
data = Data(0)

# ---- group: 2_
data_2 = Data(0)

# ---- group: 3_
data_3 = Data(0)

# ---- group: r_
# Custom
rev = Data(0)

# ---- group: g_
# Group
general = Data(0)

# ---- group: c_
core = Data(0)

# ---- group: o_
# Out
output = Data(0)

# ---- group: v_
# Revision
visual = Data(0)

# ----
image = ClipboardImage(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)
constrloc = LBConstructLocation(name="Ry", latitude="56.0920", longitude="9.764409", time_zone="1", elevation="50")  # -> location; plug-in component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
lb_location = Data(constrloc)

image_2 = ClipboardImage(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)
image_3 = ClipboardImage(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)
pt = Point(Point(61.65095357, 45.55798624, 10.5))
geo = Geometry([<extrusion referenced from the Rhino model> x3])

image_4 = ClipboardImage(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)
x_times_pr_hr = Panel("12")
geo_2 = Geometry(geo)
pt_2 = Point(pt)
meshit3 = MeshIt3(mesh_brep=geo_2)
lng = ListLength(List=flatten(pt_2))
bool = Boolean(lng)
default = DefaultMSS(data=flatten(bool), default_value_flattened=flatten("0"))
docunits = ConvertToDocumentUnits(ValueString="-1600mm")
docunits_2 = ConvertToDocumentUnits(ValueString="-20mm")
docunits_3 = ConvertToDocumentUnits(ValueString="-15mm")
docunits_4 = ConvertToDocumentUnits(ValueString="-10mm")
Z = UnitZ(Factor=docunits_2)
Z_2 = UnitZ(Factor=docunits_3)
Z_3 = UnitZ(Factor=docunits_4)
docunits_5 = ConvertToDocumentUnits(ValueString="1m")
docunits_6 = ConvertToDocumentUnits(ValueString="300mm")
docunits_7 = ConvertToDocumentUnits(ValueString="300mm")

analysisperiod = LBAnalysisPeriod(start_month="3", start_day="21", start_hour="2", end_month="3", end_day="21", end_hour="23", timestep=x_times_pr_hr)  # -> period, hoys, dates; plug-in component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

item = ListItem(List=analysisperiod.dates, Index=0, Wrap=True)
sunpath = LBSunPath(location=lb_location, hoys=analysisperiod.hoys, center_pt=pt_2, scale=0.3)  # -> report, vectors, altitudes, azimuths, hoys, sun_pts, analemma, daily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; plug-in component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
python_linkajou = PythonLinkajou(x=item)  # -> out, a
# ---------- python_linkajou: Python ----------
a = x[0:6]
# ---------- end python_linkajou ----------
meshray = MeshRay(Mesh=meshit3, Point=pt_2, Direction=expr("-x", sunpath.vectors))  # -> Point, Hit
datetime = LBHOYToDateTime(hoy=sunpath.hoys)  # -> month, day, hour, minute, date; plug-in component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
amp = Amplitude(Vector=sunpath.vectors, Amplitude=docunits)
nullrep = ReplaceNulls(Items=meshray.Hit, Replacements=Toggle(False))  # -> Items, Count
avr = Average(Input=sunpath.sun_pts)
ln = Line(StartPoint=pt_2, EndPoint=meshray.Point)
ln_2 = Line(StartPoint=pt_2, EndPoint=sunpath.sun_pts)
move = Move(Geometry=sunpath.sun_pts, Motion=amp)  # -> Geometry, Transform
cull = CullPattern(List=ln_2, CullPattern=invert(nullrep.Items))
cull_2 = CullPattern(List=datetime.date, CullPattern=default)
python = GhPythonScript(x=cull_2, y=sunpath.sun_pts)  # -> a, b; inputs y: Point3d
# ---------- python: Python ----------
__author__ = "mm1013"
__version__ = "2024.02.14"

import rhinoscriptsyntax as rs

if x is not None:
    if x.endswith("00"):
        b = y
        a = x[-5:]
# ---------- end python ----------
python_2 = GhPythonScript(x=cull_2, y=move.Geometry)  # -> a, b; inputs y: Point3d; same code as python
clean = CleanTree(RemoveNulls=True, RemoveInvalid=True, RemoveEmpty=False, Tree=python_2.a, SynchronousTree1=python_2.b)  # -> Tree, SynchronousTree1
move_2 = Move(Geometry=ln, Motion=Z)  # -> Geometry, Transform
move_3 = Move(Geometry=ln_2, Motion=Z_2)  # -> Geometry, Transform
move_4 = Move(Geometry=cull, Motion=Z_3)  # -> Geometry, Transform
ln_3 = Line(StartPoint=pt_2, EndPoint=python.b)
screentext = ScreenOrientedText(Text=python_linkajou.a, Font="Sohne Buch", Justification=8, Location=avr, SizeFactor=docunits_5, Depth=1, Absolute=True)

pt_3 = Point(pt_2)

dots = DotDisplay(Point=python.b, Colour=RGB(0, 0, 0), Size=docunits_6)
previewlw = CustomPreviewLineweights(Geometry=move_2.Geometry, Shader=ColourSwatch(SwatchColor=RGB(148, 148, 148)), Thickness=1, Absolute=False)
dots_2 = DotDisplay(Point=pt_3, Colour=RGB(0, 0, 0), Size=docunits_7)
screentext_2 = ScreenOrientedText(
    Text=clean.Tree,
    Font="Sohne Buch",
    Justification=8,
    Location=clean.SynchronousTree1,
    SizeFactor=docunits_5,
    Depth=10,
    Absolute=True)
previewlw_2 = CustomPreviewLineweights(
    Geometry=move_3.Geometry,
    Shader={diffuse=RGB(0, 0, 0), emission=RGB(0, 0, 0), shine=0.5, specular=RGB(255, 255, 255), transparency=0},
    Thickness=2,
    Absolute=False)
previewlw_3 = CustomPreviewLineweights(
    Geometry=ln_3,
    Shader={diffuse=RGB(3, 3, 3), emission=RGB(1, 1, 1), shine=0.5, specular=RGB(255, 255, 255), transparency=0},
    Thickness=4,
    Absolute=False)
previewlw_4 = CustomPreviewLineweights(
    Geometry=move_4.Geometry,
    Shader={diffuse=RGB(207, 207, 0), emission=RGB(62, 62, 0), shine=0.5, specular=RGB(255, 255, 255), transparency=0},
    Thickness=2,
    Absolute=False)

# ==== cluster DefaultMSS
default_value_flattened = ClusterInput()
data = ClusterInput()
data_2 = Data(data)
merge = Merge(Data1=flatten(data_2), Data2="0")  # -> flatten(Result)
default_value_flattened_2 = Data(flatten(default_value_flattened))
lng = ListLength(List=merge)
equals = Equality(FirstNumber=lng, SecondNumber="1")  # -> Equality, Inequality
cull = CullPattern(List=data_2, CullPattern=invert(equals.Equality))
panel = Panel(equals.Equality)
cull_2 = CullPattern(List=default_value_flattened_2, CullPattern=equals.Equality)
data_3 = Data([cull, cull_2])
data_4 = ClusterOutput(data_3)

# ==== cluster MeshIt3: Meshes everything in the input. Graft the input if you want to make several meshes, otherwise returns a joined mesh.
mesh_brep = ClusterInput()
mesh_brep_2 = Geometry(simplify(mesh_brep))
tmatch = MatchText(Text=mesh_brep_2, RegEx="(mesh)", Case=False)
tmatch_2 = MatchText(Text=mesh_brep_2, RegEx="(brep)|(polysurface)|(surface)|(extrusion)", Case=False)
group = Group(Objects=mesh_brep_2)
cull = CullPattern(List=mesh_brep_2, CullPattern=tmatch_2)
mesh = MeshBrep(
    Brep=cull,
    Settings={GridMaxCount=0, GridMinCount=16, JaggedSeams=False, MaxEdgeLength=0, MinEdgeLength=0.0001, MinTolerance=0, Refine=True, RefineAngle=0, RelativeTolerance=0.65, SimplePlanes=True, Tolerance=0})  # -> simplify(Mesh)
cull_2 = CullPattern(List=mesh_brep_2, CullPattern=tmatch)  # -> simplify(List)
mjoin = MeshJoin(Meshes=[mesh, cull_2])
fixmesh = FixMesh(invalid_mesh=mjoin)  # -> mesh; inputs invalid_mesh: list of Mesh
# ---------- fixmesh: Python ----------
__author__ = "mm1013"
__version__ = "2023.04.20"

import rhinoscriptsyntax as rs

mesh =  []
for m in invalid_mesh:
    m.Faces.CullDegenerateFaces()
    mesh.append(m)
# ---------- end fixmesh ----------
unflatten = UnflattenTree(Tree=fixmesh, Guide=group)
mesh_joined = Mesh(unflatten)
mesh_joined_2 = ClusterOutput(mesh_joined)
