# Grasshopper definition MSH2RAD_Turbo.gh (Grasshopper 1.0.7)
# Copyright: 2021

honeybee = Honeybee_Honeybee()  # -> Vviiiiiiiiiizzz; plug-in component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
ladybug = Ladybug_Ladybug()  # -> Vviiiiiiiiiizzz; plug-in component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
panel = Panel("""void plastic Wall_50
0
0
5 0.500 0.500 0.500 0.000 0.050""")
panel_2 = Panel("""void plastic Ceiling_70
0
0
5 0.700 0.700 0.700 0.000 0.050""")
panel_3 = Panel("""void plastic Floor_20
0
0
5 0.200 0.200 0.200 0.000 0.050""")
mesh_ceilings = Mesh()
mesh_walls = Mesh()
mesh_floor = Mesh()
entwine = Entwine(Branch00=mesh_walls, Branch01=mesh_ceilings, Branch02=mesh_floor, FlattenInputs=True)
entwine_2 = Entwine(Branch00=panel, Branch01=panel_2, Branch02=panel_3, FlattenInputs=True)
entwine_3 = Entwine(Branch00="Wall_50", Branch01="Ceiling_70", Branch02="Floor_20", FlattenInputs=True)
button = Button()
python = GhPythonScript()  # -> MSH2RAD
# ---------- python: Python ----------
__author__ = "mm1013"
__version__ = "2021.09.21"

import rhinoscriptsyntax as rs
import scriptcontext as sc

MSH2RAD = sc.sticky["honeybee_MeshToRAD"]


ghenv.Component.Description = "Outputs the HB MSH2RAD"

ghenv.Component.Params.Output[0].Description = "The HoneyBee MSH2RAD"
# ---------- end python ----------
mjoin = MeshJoin(Meshes=entwine)
turbo_msh2rad = CSharpScript(MSH2RAD=python, mesh=flatten(mjoin), RADMaterial=flatten(entwine_2), radFileName=flatten(entwine_3), update=button)  # -> additionalRadFiles; inputs mesh: list of Mesh, RADMaterial: list of String, radFileName: list of String, workingDir: String, update: Boolean
# ---------- turbo_msh2rad: C# usings ----------
using System.Threading.Tasks;
# ---------- turbo_msh2rad: C# ----------
    Component.Description = "This component will launch several MSH2RAD instances using honeybees library. For it to run in parallel, make sure that all the inputs are flattened," +
      " as I did not code it for tree inputs.(It'll work but not in parallel).\n" +
      "Make sure that you only input one joined mesh per radfile you will create.\n" +
      "The component remembers the outputted radfiles, so hit Update button to update.\n\n" +
      "Copyright LINK Arkitektur 2021 Copenhagen\nAuthor Mathias Sønderskov Schaltz";

    Component.Params.Input[0].Name = "MSH2RAD";
    Component.Params.Input[0].Description = "MSH2RAD from python sc.sticky";
    Component.Params.Input[1].Description = "Meshes as a list. Each mesh will become a rad file.\nRemember to join your meshes using Join Mesh component accordingly before the component.";
    Component.Params.Input[2].Description = "RADMaterials as a list of strings";
    Component.Params.Input[3].Description = "radFileNames as a list of strings";
    Component.Params.Input[4].Description = "Working directory (ie C:/Ladybug)";
    Component.Params.Input[4].AddVolatileData(new GH_Path(0), 0, "C:/ladybug");
    Component.Params.Input[5].Description = "Hit update to write the files.";


    Component.Params.Output[0].Description = "Output";
    Component.Params.Output[0].Name = "output";



    if (update)
    {
      dynamic MSHToRAD = MSH2RAD;

      string HDRTexture = null;
      object myLock = new object();

      radianceFiles.Clear();


      Parallel.For(0, mesh.Count, i =>
        {
        var meshToRadiance = MSHToRAD(new List<Mesh>() { mesh[i] }, radFileName[i], workingDir, HDRTexture, RADMaterial[i]);

        var objFile = meshToRadiance.meshToObj();
        var files = meshToRadiance.objToRAD(objFile);



        lock (myLock)
        {
          radianceFiles.Add(files[0]);
          radianceFiles.Add(files[1]);
        }


        });


    }

    additionalRadFiles = radianceFiles;
# ---------- turbo_msh2rad: C# additional code ----------
  List<string> radianceFiles = new List<string>();
# ---------- end turbo_msh2rad ----------
msh2rad = Honeybee_MSH2RAD(mesh=mjoin, RADMaterial=entwine_2, radFileName=entwine_3, writeRAD=button)  # -> materialFile, radianceFile; disabled; plug-in component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
keep = CSharpScript(materialFiles=msh2rad.materialFile, radianceFiles=msh2rad.radianceFile)  # -> files; inputs materialFiles: list of String, radianceFiles: list of String; disabled
# ---------- keep: C# ----------
    bool run = false;
    for (int i = 0; i < materialFiles.Count; i++)
    {
      if (materialFiles[i] != null)
      {
        run = true;
        break;
      }
    }
    
    for (int i = 0; i < radianceFiles.Count; i++)
    {
      if (radianceFiles[i] != null)
      {
        run = true;
        break;
      }
    }
    
    if (run)
    {
      radFiles = new List<string>();
      
      for (int i = 0; i < materialFiles.Count; i++)
      {
        if (materialFiles[i] != null)
        {
          radFiles.Add(materialFiles[i]);
        }
      }
      
      for (int i = 0; i < radianceFiles.Count; i++)
      {
        if (radianceFiles[i] != null)
        {
          radFiles.Add(radianceFiles[i]);
        }
      }
      
      
      
    }
    
    files = radFiles;
# ---------- keep: C# additional code ----------
    List<string> radFiles;
# ---------- end keep ----------
addradfiles = Text(turbo_msh2rad)
addradfiles_2 = Text(keep)
panel_4 = Panel(addradfiles_2)
panel_5 = Panel(addradfiles)
