# Grasshopper definition Update_Datadam.gh (Grasshopper 1.0.7)
# Copyright: 2021

# ---- group: simple counter
c_script = CSharpScript(run=Button(), reset=Button())  # -> count; inputs run: Boolean, reset: Boolean
# ---------- c_script: C# ----------
    if (run)
      counter++;
    count = counter;

    if(reset)
      counter = 0;
# ---------- c_script: C# additional code ----------
  int counter = 47;
# ---------- end c_script ----------

# ----
# name of all the groups
# to update dams in.
panel = Panel("dams")
triggr = RemoteDatadamTrigger(groupNames=panel, run=Button())  # -> out; inputs groupNames: list of String, run: Boolean
# ---------- triggr: C# usings ----------
using System.Linq;
using System.Drawing;
# ---------- triggr: C# ----------
    Component.Description = "This component will remove trigger datadams.\n\n" +
      "to use it, place your datadams in a group, name the group (right click) and insert the\n" +
      "group name in this component. Hit Run to update all the datadams\n\n" +

      "Copyright LINK Arkitektur 2021 Copenhagen. Author Mathias Sønderskov Schaltz";

    Component.Params.Input[0].Name = "groupNames";
    Component.Params.Input[0].Description = "Names of the groups where we placed the datadams.";
    Component.Params.Input[1].AddVolatileData(new GH_Path(0), 0, false);
    Component.Name = "Remote Datadam Trigger";
    Component.NickName = "TriggR";

    Component.Params.Input[1].Description = "Set to true to run";

    if (run)
    {

      foreach (var groupName in groupNames)
      {
        ExpireDams(groupName);
      }
    }
# ---------- triggr: C# additional code ----------
  void ExpireDams(string groupName){


    var groups = GrasshopperDocument.Objects.OfType<Grasshopper.Kernel.Special.GH_Group>();

    var keyGroup = groups.Where(g => g.NickName == groupName);

    foreach (var myGroup in keyGroup)
    {


      var objects = myGroup.Objects();
      foreach (var obj in objects)
      {
        Grasshopper.Kernel.Components.GH_DataDamComponent myDam = obj as Grasshopper.Kernel.Components.GH_DataDamComponent;
        if (myDam != null)
        {
          myDam.ExpireSolution(true);
          Print("Triggered : " + obj.GetType().ToString());
        }
      }

    }




  }
# ---------- end triggr ----------

panel_2 = Panel(triggr)

# ---- group: dams
dam = DataDam(DataA=c_script, BufferDelay=10000000, BufferMode=0)

dam_2 = DataDam(DataA=c_script, BufferDelay=10000000, BufferMode=0)

# ----
panel_3 = Panel(dam)
panel_4 = Panel(dam_2)
